# Dynamo graph SetAirTerminalAirflow.dyn (Dynamo 1.3.3.4111)

# group: Get Air Terminals.
categories = Categories("DuctTerminal")
all_elements_of_category = ElementsOfCategory(categories)

# group: Get Spaces.
categories_2 = Categories("MEPSpaces")
all_elements_of_category_2 = ElementsOfCategory(categories_2)

# group: Checks if Air Terminal is in Space and Filters out Spaces with no Air Terminals.
elements_in_space = Custom[Elements in Space](Element=all_elements_of_category, Space=all_elements_of_category_2)  # This node will take an input of Spaces and Elements and attempt to group all elements by Room that it is located in. For elements that are placed by Line and not a Point, a mid point of line will be used to determine location.
isEmpty = List.IsEmpty(elements_in_space@L2)
filterByBoolMask = List.FilterByBoolMask(list=elements_in_space, mask=isEmpty)
filterByBoolMask_2 = List.FilterByBoolMask(list=all_elements_of_category_2, mask=isEmpty)

# group: <Space Numbers> that will be manually manipulated by the designer.
space_number_list_to_filter_out = CodeBlock { {"000"}; }

# group: Generates Manual Manipulation <Space Number> filter.
code_block = CodeBlock { "Number"; }
getParameterValueByName = Element.GetParameterValueByName(element=filterByBoolMask_2.out, parameterName=code_block)
ne = getParameterValueByName != space_number_list_to_filter_out  # lacing=Longest

# group: Filter out Spaces and associated Air Terminals by <Space Number> that require Manual Manipulation.
filterByBoolMask_3 = List.FilterByBoolMask(list=filterByBoolMask.out, mask=ne)
filterByBoolMask_4 = List.FilterByBoolMask(list=filterByBoolMask_2.out, mask=ne)

# group: Air Terminal relay.
flatten = Flatten(filterByBoolMask_3.in)

# group: Space Airflow Parameters to set.
code_block_2 = CodeBlock { "TRACE Calculated Diffuser Airflow"; }
code_block_3 = CodeBlock { "TRACE Calculated Return Airflow"; }
code_block_4 = CodeBlock { "TRACE Calculated Ventilation Airflow"; }
code_block_5 = CodeBlock { "TRACE Calculated Exhaust Airflow"; }
code_block_6 = CodeBlock { "TRACE Calculated Rm Exhaust Airflow"; }
create = List.Create(code_block_2, code_block_3, code_block_4, code_block_5, code_block_6)

# group: Get Space Airflows of Spaces that contain Air Terminals.
code_block_7 = CodeBlock(element=filterByBoolMask_4.in, parameter=create) { element<1>.GetParameterValueByName(parameter<2><1>); }
code_block_8 = CodeBlock { 1; }
flatten_2 = List.Flatten(list=code_block_7, amt=code_block_8)

# group: Duct System Types that correspond in order to Space Airflow Parameters.
code_block_9 = CodeBlock { "Supply Air"; }
code_block_10 = CodeBlock { "Return Air"; }
code_block_11 = CodeBlock { "Ventilation Air"; }
code_block_12 = CodeBlock { "Room Exhaust Return Air"; }
code_block_13 = CodeBlock { "Room Exhaust Air"; }
create_2 = List.Create(code_block_9, code_block_10, code_block_11, code_block_12, code_block_13)

# group: Get Duct System Types of Air Terminals.
code_block_14 = CodeBlock { "System Type"; }
getParameterValueByName_2 = Element.GetParameterValueByName(element=filterByBoolMask_3.in, parameterName=code_block_14)
name = Element.Name(getParameterValueByName_2)

# group: Counts Number Air Terminals per Duct System Type.
code_block_15 = CodeBlock(x=create_2, y=name) { x<1> == y<2><1>; }
countTrue = CountTrue(code_block_15@L2, lacing=Longest)
count = Count(filterByBoolMask_4.in)
chop = List.Chop(list=countTrue, lengths=count)
transpose = List.Transpose(chop)

# group: Replace zeroes in Terminal Type Count to prevent divide by zero condition.
code_block_16 = CodeBlock { 0; }
ne_2 = transpose != code_block_16
code_block_17 = CodeBlock { 10000; }
if_ = If(test=ne_2, true=transpose, false=code_block_17)

# group: Divide airflow between Air Terminals of the same Type in a Space.
div = flatten_2 / if_  # lacing=Longest

# group: Assigns Duct System Type Index to Air Terminal Type.
flatten_3 = Flatten(name)
indexOf = IndexOf(create_2)  # unwired: arg1
map = List.Map(list=flatten_3, f_x=indexOf)
count_2 = List.Count(name@L2)
chop_2 = List.Chop(list=map, lengths=count_2)

# group: Assign the Airflow value to each Air Terminal in a Space.
getItemAtIndex = List.GetItemAtIndex(list=div, index=chop_2, lacing=Longest)
flatten_4 = Flatten(getItemAtIndex)

# group: Set Air Terminal Airflows.
code_block_18 = CodeBlock { "Flow"; }
setParameterByName = Element.SetParameterByName(element=flatten, parameterName=code_block_18, value=flatten_4)
