# Dynamo graph 02_CreateFloorWithExteriorOutline.dyn (Dynamo 2.6.1.8786)
# packages: archi-lab.net 2020.23.5

# group: Model line type
wall_line_style = LineStyleUi("Walls - Exterior")  # graph input

# group: Get model lines
name = Element.Name(element=wall_line_style)
select_model_lines_by_style = Custom[Select Model Lines by Style](styleName=name)  # package archi-lab.net; This node will select all model lines in the revit project by a line style name.

# group: Level of 'Exterior Wall' model lines
level_of_model_lines = Levels("Level 1")  # graph input
name_2 = Level.Name(level=level_of_model_lines)

# group: Filter for model lines by Level
parameters = Element.Parameters(element=select_model_lines_by_style)
code_block = CodeBlock { 11; }
getItemAtIndex = List.GetItemAtIndex(list=parameters@L2, index=code_block)
string_from_object = FromObject(obj=getItemAtIndex)
contains = String.Contains(str=string_from_object, searchFor=name_2)
filterByBoolMask = List.FilterByBoolMask(list=select_model_lines_by_style, mask=contains)

curve = CurveElement.Curve(curveElement=filterByBoolMask.in)

# group: Floor Type
floor_types = FloorTypes("Generic - 4\"")  # graph input

byOutlineTypeAndLevel = Floor.ByOutlineTypeAndLevel(outlineCurves=curve, floorType=floor_types, level=level_of_model_lines)
