# Dynamo graph 04_CreateMassesWithSpaces.dyn "01E_CreateMassesWithSpaces" (Dynamo 2.6.1.8786)
# packages: Rhythm 2020.1.24, spring nodes 203.1.0

# group: Element of Interest
all_elements_of_model_category = ModelCategoriesCollect("Spaces")

# group: FamilyType 'solidGeometry'
solids = Element.Solids(element=all_elements_of_model_category)
flatten = List.Flatten(list=solids)

# group: Family Template Path
file_path = Filename("C:\ProgramData\Autodesk\RVT 2021\Family Templates\English-Imperial\Conceptual Mass\Mass.rft")

# group: FamilyType 'name'
name = Space.Name(space=all_elements_of_model_category)
number = Space.Number(space=all_elements_of_model_category)
code_block = CodeBlock(spaceName=name, spaceNumber=number) { spaceName; spaceNumber; name=spaceName + " " + spaceNumber; }

# group: Family Instance Category
categories = Categories("OST_Mass")

# group: Material
code_block_2 = CodeBlock { "Analytical Spaces"; }

byName = Material.ByName(name=code_block_2)
ꟿ_familyinstance_bygeometry = Custom[ꟿ FamilyInstance.ByGeometry](geometry=flatten, familyTemplatePath=file_path, familyName=code_block.name, category=categories, materialName=byName)  # package spring nodes; You must provide a valid family template path that will be used for all input geometry objects. The project units(and not the templates) will be used to determine the size of the output geometry. The provided category will be used only if the family template supports it. If not, the default template category will be used instead. Likewise, the family material(provided as a string) will be set only if a material with that name exists in the template. If not, the default material will be used instead ("By Category"). For void cuts, the material settings will be ignored. The Subcategory name is an optional input. If you'd like to skip assigning a Subcategory to any new instance, simply use null. The node expects a unique family name for each geometry object. The rest of the input lists will be processed as if the node lacing is set to longest.
