# Dynamo graph 01_CreateDaylightZonesWithSpaces.dyn "05_CreateDaylightZonesWithSpaces" (Dynamo 2.6.1.8786)
# packages: Rhythm 2020.1.24, spring nodes 203.1.0, archi-lab.net 2023.213.1722

# group: Element of Interest
all_elements_of_model_category = ModelCategoriesCollect("Spaces")

# group: Mass parameters.
offset_from_walls_mm = DoubleInput(-500)
solid_thickness_in = DoubleInput(1)
solid_height_mm = DoubleInput(850)

# group: Make solid from Space and Set at Height.
finishBoundary = Space.FinishBoundary(space=all_elements_of_model_category)
byJoinedCurves = PolyCurve.ByJoinedCurves(curves=finishBoundary)
mm_to_feet_conversion = CodeBlock(offset=offset_from_walls_mm) { (offset/25.4)/12; }
boolean = BoolSelector(false)
offset = PolyCurve.Offset(signedDistance=mm_to_feet_conversion, extendCircular=boolean)  # unwired: polyCurve
map = List.Map(list=byJoinedCurves, f_x=offset)
flatten = List.Flatten(list=map)
inches_to_feet = CodeBlock(thickness=solid_thickness_in) { thickness / 12; }
extrudeAsSolid = Curve.ExtrudeAsSolid(curve=flatten, distance=inches_to_feet)
mm_to_feet_conversion_2 = CodeBlock(surfaceHeight=solid_height_mm) { (surfaceHeight/25.4)/12; }
translate = Geometry.Translate(geometry=extrudeAsSolid, zTranslation=mm_to_feet_conversion_2)

# group: Family Template Path
file_path = Filename("C:\ProgramData\Autodesk\RVT 2021\Family Templates\English-Imperial\Conceptual Mass\Mass.rft")

# group: FamilyType 'name'
number = Space.Number(space=all_elements_of_model_category)
code_block = CodeBlock(spaceNumber=number) { spaceNumber; df="DF-" + spaceNumber; }

# group: Family Instance Category
categories = Categories("OST_Mass")

# group: Material
code_block_2 = CodeBlock { "Analytical Spaces"; }

byName = Material.ByName(name=code_block_2)
ꟿ_familyinstance_bygeometry = Custom[ꟿ FamilyInstance.ByGeometry](geometry=translate, familyTemplatePath=file_path, familyName=code_block.df, category=categories, materialName=byName)  # frozen; package spring nodes; You must provide a valid family template path that will be used for all input geometry objects. The project units(and not the templates) will be used to determine the size of the output geometry. The provided category will be used only if the family template supports it. If not, the default template category will be used instead. Likewise, the family material(provided as a string) will be set only if a material with that name exists in the template. If not, the default material will be used instead ("By Category"). For void cuts, the material settings will be ignored. The Subcategory name is an optional input. If you'd like to skip assigning a Subcategory to any new instance, simply use null. The node expects a unique family name for each geometry object. The rest of the input lists will be processed as if the node lacing is set to longest.

# group: Create Material for each Space
create = archilab.Revit.Elements.Materials.Create(name=code_block.df)
code_block_3 = CodeBlock { "Transparency"; }
count = List.Count(list=code_block.df)
code_block_4 = CodeBlock(count=count) { 0..(count-1)..1; }
setParameterByName = Element.SetParameterByName(element=create, parameterName=code_block_3, value=code_block_4)
daylight_visualizer_zone_name = CodeBlock(number=code_block_4) { "w_zone-" + number; }

byGeometry = DirectShape.ByGeometry(geometry=translate, category=categories, material=setParameterByName)
code_block_5 = CodeBlock { "Mark"; }
setParameterByName_2 = Element.SetParameterByName(element=byGeometry, parameterName=code_block_5, value=daylight_visualizer_zone_name)
parameters = Element.Parameters(element=byGeometry)
