# Dynamo graph 02_CreateDaylightZonesWithZones.dyn (Dynamo 2.6.1.8786)
# packages: archi-lab.net 2023.213.1722, Rhythm 2020.1.24

# group: Element of interest
all_elements_of_model_category = ModelCategoriesCollect("HVAC Zones")

# group: Filter out 'Default' zone.
code_block = CodeBlock { "Name"; "Default"; }
getParameterValueByName = Element.GetParameterValueByName(element=all_elements_of_model_category, parameterName=code_block.out0)
contains = String.Contains(str=getParameterValueByName, searchFor=code_block.out1)
filterByBoolMask = List.FilterByBoolMask(list=all_elements_of_model_category, mask=contains)
filterByBoolMask_2 = List.FilterByBoolMask(list=getParameterValueByName, mask=contains)

# group: Get HVAC Zone boundary polycurves
python_script = Python(IN[0]=filterByBoolMask.out)
# ---------- python_script.python (59 lines) ----------
#https://forum.dynamobim.com/t/zone-hvac-or-system-geometries/73813/10

# Load the Python Standard and DesignScript Libraries
import clr
import sys
import System
clr.AddReference('ProtoGeometry')
from Autodesk.DesignScript.Geometry import *
import Autodesk.DesignScript.Geometry as DS

#import Revit API
clr.AddReference('RevitAPI')
import Autodesk
from Autodesk.Revit.DB import *
import Autodesk.Revit.DB as DB

clr.AddReference('RevitNodes')
import Revit
clr.ImportExtensions(Revit.GeometryConversion)
clr.ImportExtensions(Revit.Elements)


def groupCurves(lstCurve, i = 0, max_iter = 10000):
	if len(lstCurve) > 0 and i < max_iter:
		loopCurve = [lstCurve.pop(0)]
		lst_idx = []
		while i < max_iter: 
			i += 1
			lenStart = len(lst_idx)
			for idx, c in enumerate(lstCurve):
				if any(c.DistanceTo(j) < 0.1 for j in loopCurve) and idx not in lst_idx:
					lst_idx.append(idx)
					loopCurve.append(c)
			if len(lst_idx) == lenStart:
				break

		otherCurves = [c for i, c in enumerate(lstCurve) if i not in lst_idx]
		return [DS.PolyCurve.ByJoinedCurves(loopCurve)] + groupCurves(otherCurves, i)
	else:
		return []

zones = UnwrapElement(IN[0])

optSpace = SpatialElementBoundaryOptions()
optSpace.SpatialElementBoundaryLocation  = SpatialElementBoundaryLocation.CoreCenter
allcurves = []
for zone in zones:
	surfacesSpace = []
	for space in zone.Spaces:
		ArrArrSegments = space.GetBoundarySegments(optSpace)
		for segments in ArrArrSegments:
			proto_segments = [x.GetCurve().ToProtoType() for x in segments]
			polyCurve = DS.PolyCurve.ByJoinedCurves(proto_segments)
			surfacesSpace.append(polyCurve.Patch())

	groupSurface = DS.Surface.ByUnion(surfacesSpace)
	allcurves.append(groupCurves(list(groupSurface.PerimeterCurves())))

OUT = allcurves
# ----------------------------------------
flatten = List.Flatten(list=python_script)

# group: Mass parameters.
offset_from_walls_mm = DoubleInput(-500)
solid_thickness_in = DoubleInput(1)
solid_height_mm = DoubleInput(850)

# group: Make solid from Space and Set at Height.
mm_to_feet_conversion = CodeBlock(offset=offset_from_walls_mm) { (offset/25.4)/12; }
boolean = BoolSelector(false)
offset = PolyCurve.Offset(signedDistance=mm_to_feet_conversion, extendCircular=boolean)  # unwired: polyCurve
map = List.Map(list=flatten, f_x=offset)
flatten_2 = List.Flatten(list=map)
inches_to_feet = CodeBlock(thickness=solid_thickness_in) { thickness / 12; }
extrudeAsSolid = Curve.ExtrudeAsSolid(curve=flatten_2, distance=inches_to_feet)
mm_to_feet_conversion_2 = CodeBlock(surfaceHeight=solid_height_mm) { (surfaceHeight/25.4)/12; }
translate = Geometry.Translate(geometry=extrudeAsSolid, zTranslation=mm_to_feet_conversion_2)

# group: Family Instance Category
categories = Categories("OST_Mass")

# group: zone name
code_block_2 = CodeBlock(zoneNumber=filterByBoolMask_2.out) { "w_zone-" + zoneNumber; }

# group: Create Material for each Space
create = archilab.Revit.Elements.Materials.Create(name=code_block_2)
code_block_3 = CodeBlock { "Transparency"; }
count = List.Count(list=code_block_2)
code_block_4 = CodeBlock(count=count) { 0..(count-1)..1; }
setParameterByName = Element.SetParameterByName(element=create, parameterName=code_block_3, value=code_block_4)

byGeometry = DirectShape.ByGeometry(geometry=translate, category=categories, material=setParameterByName)
code_block_5 = CodeBlock { "Mark"; }
setParameterByName_2 = Element.SetParameterByName(element=byGeometry, parameterName=code_block_5, value=code_block_2)
parameters = Element.Parameters(element=byGeometry)
