# Dynamo graph SetSpaceNumberIntoRooms.dyn (Dynamo 1.3.3.4111)

# group: Gets all Room elements.
categories = Categories("Rooms")
all_elements_of_category = ElementsOfCategory(categories)

# group: Finds Room centroids and formats the list.
solids = Element.Solids(all_elements_of_category)
centroid = Solid.Centroid(solids)
flatten = Flatten(centroid)

# group: Loads Revit link into Dynamo for processing.
links = Links("18-034 Bay View_MECH.rvt : 1 : location &lt;Not Shared&gt;")
getDocument = Rhythm.Revit.Elements.RevitLink.GetDocument(links)

# group: Gets Spaces from Revit link and pulls in Space geometry.
categories_2 = Categories("MEPSpaces")
get_all_elements_from_linked = Custom[Get All Elements From Linked Model](LinkDoc=getDocument, Category=categories_2)  # This node is based on code posted by Julien Benoit. Big thanks to Julien for sharing his work. This node will retrieve all elements of a given category from a given linked model.
geometry = Element.Geometry(get_all_elements_from_linked)

# group: Checks if the Room centroid is in a Space and formats the list.
doesIntersect = Geometry.DoesIntersect(geometry=geometry)  # unwired: other
map = List.Map(list=flatten, f_x=doesIntersect)
flatten_2 = Flatten(map)

# group: Gets Space numbers.
code_block = CodeBlock { "Number"; }
getParameterValueByName = Element.GetParameterValueByName(element=get_all_elements_from_linked, parameterName=code_block)

# group: Chops check results back into Room chunks.
count = List.Count(getParameterValueByName)
chop = List.Chop(list=flatten_2, lengths=count)

# group: Check if Rooms correspond to a Space.
allFalse = AllFalse()  # unwired: arg0
map_2 = List.Map(list=chop, f_x=allFalse)
code_block_2 = CodeBlock { true; }
eq = map_2 == code_block_2
code_block_3 = CodeBlock { false; }
code_block_4 = CodeBlock { true; }
if_ = If(test=eq, true=code_block_3, false=code_block_4)

# group: Filter out Rooms without a corresponding Space.
filterByBoolMask = List.FilterByBoolMask(list=all_elements_of_category, mask=if_)

# group: Filter out Rooms without a corresponding Space.
filterByBoolMask_2 = List.FilterByBoolMask(list=chop, mask=if_)
watch = Watch(filterByBoolMask_2.in)

# group: Subsitute Space Number for "true" results.
code_block_5 = CodeBlock(check=watch, spaces=getParameterValueByName) { spacenumber(check,spaces); }
code_block_6 = CodeBlock()
# ---------- code_block_6.designscript (5 lines) ----------
def spacenumber(check : var[],spaces : var[])
{
v = check == true? spaces : null;
return = v;
};
# ----------------------------------------

# group: Format Space Number list for entry.
removeNulls = Lists.Manage.RemoveNulls(code_block_5)
flatten_3 = Flatten(removeNulls)

# group: Set <Space Number> into Rooms.
code_block_7 = CodeBlock { "Space Number"; }
setParameterByName = Element.SetParameterByName(element=filterByBoolMask.in, parameterName=code_block_7, value=flatten_3)
