# Dynamo graph SetSpaceParameterListViaCsvFile.dyn (Dynamo 1.3.3.4111)

# group: Get Revit <Space Number> data and sort by <Space Number>.
element_of_interest = Categories("MEPSpaces")
all_elements_of_category = ElementsOfCategory(element_of_interest)
space_id_parameter = StringInput("Number")
getParameterValueByName = Element.GetParameterValueByName(parameterName=space_id_parameter)  # unwired: element
sortByFunction = SortByFunction(all_elements_of_category, getParameterValueByName)

# group: Space Parameters (in order of data input file)
space_parameter = CodeBlock { "TRACE Calculated Diffuser Airflow"; }
space_parameter_2 = CodeBlock { "TRACE Calculated Ventilation Airflow"; }
space_parameter_3 = CodeBlock { "TRACE Calculated Infiltration Airflow"; }
space_parameter_4 = CodeBlock { "TRACE Calculated Return Airflow"; }
space_parameter_5 = CodeBlock { "TRACE Calculated Exhaust Airflow"; }
space_parameter_6 = CodeBlock { "TRACE Calculated Rm Exhaust Airflow"; }
space_parameter_7 = CodeBlock { "TRACE Calculated Total Cooling Load"; }
space_parameter_8 = CodeBlock { "TRACE Calculated Sensible Cooling Load"; }
space_parameter_9 = CodeBlock { "TRACE Calculated Cooling EDB"; }
space_parameter_10 = CodeBlock { "TRACE Calculated Cooling EWB"; }
space_parameter_11 = CodeBlock { "TRACE Calculated Cooling EHR"; }
space_parameter_12 = CodeBlock { "TRACE Calculated Cooling LDB"; }
space_parameter_13 = CodeBlock { "TRACE Calculated Cooling LWB"; }
space_parameter_14 = CodeBlock { "TRACE Calculated Cooling LHR"; }
space_parameter_15 = CodeBlock { "TRACE Calculated Total Heating Load"; }
space_parameter_16 = CodeBlock { "TRACE Calculated Heating EDB"; }
space_parameter_17 = CodeBlock { "TRACE Calculated Heating LDB"; }
create = List.Create(space_parameter, space_parameter_2, space_parameter_3, space_parameter_4, space_parameter_5, space_parameter_6, space_parameter_7, space_parameter_8, space_parameter_9, space_parameter_10, space_parameter_11, space_parameter_12, space_parameter_13, space_parameter_14, space_parameter_15, space_parameter_16, space_parameter_17)

# group: Space Parameter On/Off Switches (in order of data input file)
trace_calculated_diffuser = BoolSelector(true)  # "TRACE Calculated Diffuser Airflow"
trace_calculated_ventilation = BoolSelector(true)  # "TRACE Calculated Ventilation Airflow"
trace_calculated_infiltration = BoolSelector(true)  # "TRACE Calculated Infiltration Airflow"
trace_calculated_return_airflow = BoolSelector(true)
trace_calculated_exhaust_airflow = BoolSelector(true)
trace_calculated_rm_exhaust = BoolSelector(true)  # "TRACE Calculated Rm Exhaust Airflow"
trace_calculated_total_cooling = BoolSelector(true)  # "TRACE Calculated Total Cooling Load"
trace_calculated_sensible = BoolSelector(true)  # "TRACE Calculated Sensible Cooling Load"
trace_calculated_cooling_edb = BoolSelector(true)
trace_calculated_cooling_ewb = BoolSelector(true)
trace_calculated_cooling_ehr = BoolSelector(true)
trace_calculated_cooling_ldb = BoolSelector(true)
trace_calculated_cooling_lwb = BoolSelector(true)
trace_calculated_cooling_lhr = BoolSelector(true)
trace_calculated_total_heating = BoolSelector(true)  # "TRACE Calculated Total Heating Load"
trace_calculated_heating_edb = BoolSelector(true)
trace_calculated_heating_ldb = BoolSelector(true)
create_2 = List.Create(trace_calculated_diffuser, trace_calculated_ventilation, trace_calculated_infiltration, trace_calculated_return_airflow, trace_calculated_exhaust_airflow, trace_calculated_rm_exhaust, trace_calculated_total_cooling, trace_calculated_sensible, trace_calculated_cooling_edb, trace_calculated_cooling_ewb, trace_calculated_cooling_ehr, trace_calculated_cooling_ldb, trace_calculated_cooling_lwb, trace_calculated_cooling_lhr, trace_calculated_total_heating, trace_calculated_heating_edb, trace_calculated_heating_ldb)

# group: Read DataIn and process.
delimiter = StringInput(",")
file_path = Filename("..\..\..\..\Projects\2018\18-002 Falmouth Memorial Library\11_BIM\Design_Process\_Energy\gbxml\2018-12-21\18002 REVIT VENT DATA_GBXML18-12-21.csv")
readText = File.ReadText(file_path)
fromCSV = Custom[List.FromCSV](delimiter=delimiter, CSVstring=readText)  # Converts the content of a given CSV file to a list

# group: Format DataIn and sort by <Space Number>.
number_of_data_headers_to_remove = IntegerSlider(1, range=0..3 step 1)  # "Number of Data Headers to Remove (Count starts at 1)"
dropItems = List.DropItems(list=fromCSV, amount=number_of_data_headers_to_remove)
data_column_of_space_number = IntegerSlider(0, range=0..3 step 1)  # "Data Column of Space Number (Count starts at 0)"
getItemAtIndex = List.GetItemAtIndex(list=dropItems@L2, index=data_column_of_space_number)
sortByKey = List.SortByKey(list=dropItems, keys=getItemAtIndex)

# group: Check Revit <Space Number> against DataIn <Space Number>
getParameterValueByName_2 = Element.GetParameterValueByName(element=sortByFunction, parameterName=space_id_parameter)
containsItem = List.ContainsItem(list=getParameterValueByName_2, item=getItemAtIndex)
filterByBoolMask = List.FilterByBoolMask(list=sortByKey.sorted_list, mask=containsItem)

# group: Drop <Space Number> from data input.
code_block = CodeBlock { 1; }
dropItems_2 = List.DropItems(list=filterByBoolMask.in@L2, amount=code_block)

# group: Space Parameter Scalars (in order of data input file)
trace_calculated_diffuser_2 = CodeBlock { 1; }  # "TRACE Calculated Diffuser Airflow"
trace_calculated_ventilation_2 = CodeBlock { 1; }  # "TRACE Calculated Ventilation Airflow"
trace_calculated_infiltration_2 = CodeBlock { 1; }  # "TRACE Calculated Infiltration Airflow"
trace_calculated_return_airflow_2 = CodeBlock { 1; }
trace_calculated_exhaust_airflow_2 = CodeBlock { 1; }
trace_calculated_rm_exhaust_2 = CodeBlock { 1; }  # "TRACE Calculated Rm Exhaust Airflow"
trace_calculated_total_cooling_2 = CodeBlock { 1000; }  # "TRACE Calculated Total Cooling Load"
trace_calculated_sensible_2 = CodeBlock { 1000; }  # "TRACE Calculated Sensible Cooling Load"
trace_calculated_cooling_edb_2 = CodeBlock { 1; }
trace_calculated_cooling_ewb_2 = CodeBlock { 1; }
trace_calculated_cooling_ehr_2 = CodeBlock { 1; }
trace_calculated_cooling_ldb_2 = CodeBlock { 1; }
trace_calculated_cooling_lwb_2 = CodeBlock { 1; }
trace_calculated_cooling_lhr_2 = CodeBlock { 1; }
trace_calculated_total_heating_2 = CodeBlock { 1000; }  # "TRACE Calculated Total Heating Load"
trace_calculated_heating_edb_2 = CodeBlock { 1; }
trace_calculated_heating_ldb_2 = CodeBlock { 1; }
create_3 = List.Create(trace_calculated_diffuser_2, trace_calculated_ventilation_2, trace_calculated_infiltration_2, trace_calculated_return_airflow_2, trace_calculated_exhaust_airflow_2, trace_calculated_rm_exhaust_2, trace_calculated_total_cooling_2, trace_calculated_sensible_2, trace_calculated_cooling_edb_2, trace_calculated_cooling_ewb_2, trace_calculated_cooling_ehr_2, trace_calculated_cooling_ldb_2, trace_calculated_cooling_lwb_2, trace_calculated_cooling_lhr_2, trace_calculated_total_heating_2, trace_calculated_heating_edb_2, trace_calculated_heating_ldb_2)

# group: Space Parameter & Space Parameter Scaler Filter
filterByBoolMask_2 = List.FilterByBoolMask(list=create, mask=create_2)
filterByBoolMask_3 = List.FilterByBoolMask(list=create_3, mask=create_2)

# group: Convert DataIn to numbers and scale for input.
toNumber = String.ToNumber(dropItems_2)
mul = toNumber@L2 * filterByBoolMask_3.in

# group: Set data into Space Parameters.
code_block_2 = CodeBlock(element=sortByFunction, parameter=filterByBoolMask_2.in, value=mul) { element<1>.SetParameterByName(parameter<2><1>,value<1><1>); }
