# Dynamo graph SetSpaceParameterListViaCsvFile_TRACE.dyn (Dynamo 2.6.1.8786)

# group: Get Revit <Space Number> data and sort by <Space Number>.
element_of_interest = Categories("OST_MEPSpaces")  # graph input
all_elements_of_category = ElementsOfCategory(Category=element_of_interest)
code_block = CodeBlock { "Number"; }
getParameterValueByName = Element.GetParameterValueByName(element=all_elements_of_category, parameterName=code_block)
sortByKey = List.SortByKey(list=all_elements_of_category, keys=getParameterValueByName)

# group: Choose file to read in.
file_path = Filename("..\..\..\..\..\Projects\2022\22-004 WRA TCI\6_Project Data\Design_Process\_Energy\22-004 Code Processed Room Checksums_22-02-26.csv")  # graph input

# group: Note: Dynamo imports <Space Numbers> as a number type rather than as a text type.
boolean = BoolSelector(false)
importCSV = Data.ImportCSV(filePath=file_path, transpose=boolean)

code_block_2 = CodeBlock { 0; 1; }
code_block_3 = CodeBlock { 2; 1; }

# group: Get <Space> parameter values from data file.
dropItems = List.DropItems(list=importCSV@L2, amount=code_block_2.out1)
dropItems_2 = List.DropItems(list=dropItems, amount=code_block_3.out1)

# group: Sort parameter values by <Space Number>.
code_block_4 = CodeBlock { 0; }
getItemAtIndex = List.GetItemAtIndex(list=dropItems_2, index=code_block_4)
string_from_object = FromObject(obj=getItemAtIndex)
code_block_5 = CodeBlock { "'"; ""; }
replace = String.Replace(str=string_from_object, searchFor=code_block_5.out0, replaceWith=code_block_5.out1)
sortByKey_2 = List.SortByKey(list=dropItems_2@L2, keys=replace)

# group: Prepare list data.
code_block_6 = CodeBlock { 1; 0; }
getItemAtIndex_2 = List.GetItemAtIndex(list=sortByKey_2.sorted_keys, index=code_block_6.out1)
dropItems_3 = List.DropItems(list=sortByKey_2.sorted_list, amount=code_block_6.out0)
transpose = List.Transpose(lists=dropItems_3)

setIntersection = List.SetIntersection(list1=sortByKey.sorted_keys, list2=getItemAtIndex_2)

# group: Check Revit <Space Number> against DataIn <Space Number>
contains = List.Contains(list=sortByKey.sorted_keys, item=setIntersection, lacing=CrossProduct)
allFalse = List.AllFalse(list=contains@L2)
filterByBoolMask = List.FilterByBoolMask(list=sortByKey.sorted_list, mask=allFalse)
filterByBoolMask_2 = List.FilterByBoolMask(list=sortByKey.sorted_keys, mask=allFalse)

# group: Get <Space> parameters from data file.
getItemAtIndex_3 = List.GetItemAtIndex(list=importCSV@L2, index=code_block_2.out0)
dropItems_4 = List.DropItems(list=getItemAtIndex_3, amount=code_block_3.out0)

# group: Check DataIn <Space Number> against Revit <Space Number>
contains_2 = List.Contains(list=getItemAtIndex_2, item=setIntersection, lacing=CrossProduct)
allFalse_2 = List.AllFalse(list=contains_2@L2)
filterByBoolMask_3 = List.FilterByBoolMask(list=transpose, mask=allFalse_2)
transpose_2 = List.Transpose(lists=filterByBoolMask_3.out)

# group: Sets lists of element parameters into elements.
setParameterByName = Element.SetParameterByName(element=filterByBoolMask.out)  # unwired: parameterName, value
combine = List.Combine(comb=setParameterByName, list1=dropItems_4, list2=transpose_2)

filtered_space_numbers = Watch(filterByBoolMask_2.in)  # graph output
